# Dynamo custom node DynanimatorFunction Camera Position With Fixed Target.dyf (Dynamo 0.7.5.3566)
# category: Dynanimator.Functions
# Animates the camera of a perspective view around a fixed target.

View = Input()
Camera_Path = Input()
Total_Iterations = Input()
Iteration = Input()
code_block = CodeBlock(n=Total_Iterations, iteration=Iteration) { 1/n*iteration; }
pointAtParameter = Curve.PointAtParameter(Camera_Path, code_block)
Target_Position = Input()
setOrientationByEyeAndTargetPosition = Custom[PerspectiveView.SetOrientationByEyeAndTargetPosition](View=View, Eye_Position=pointAtParameter, Target_Position=Target_Position)  # Sets the orientation of a given perspective view based on a given eye and target position
end = Revit.Transaction.Transaction.End(setOrientationByEyeAndTargetPosition)
Directory_Path = Input()
string = StringInput("\")
name = Element.Name(View)
string_2 = StringInput("_")
string_from_object = FromObject(Iteration)
string_3 = StringInput(".png")
concat = String.Concat(Directory_Path, string, name, string_2, string_from_object, string_3)
exportAsImage = View.ExportAsImage(View, concat)
end_2 = Revit.Transaction.Transaction.End(exportAsImage)
compose = ComposeFunctions(end, end_2)  # "Function.Compose"
