# Dynamo graph Camera Position With Fixed Target.dyn (Dynamo 0.7.5.3566)

integer_slider = IntegerSlider(10, range=0..100)
code_block = CodeBlock(n=integer_slider) { 0..(n-1); }
directory_path = Directory("C:\Users\adieckmann\Desktop")
views = Views("Dynanimator_Perspective_View")
select_model_element = DSModelElementSelection()  # 1 picked in the model
geometry = Element.Geometry(select_model_element)
firstItem = List.FirstItem(geometry)
select_point_on_face = DSPointOnElementSelection()  # 1 picked in the model
dynanimate_camera_position_with = Custom[Dynanimate Camera Position With Fixed Target](Total_Iterations=integer_slider, Directory_Path=directory_path, View=views, Camera_Path=firstItem, Target_Position=select_point_on_face)  # Animates the camera of a perspective view around a fixed target.
map = List.Map(code_block, dynanimate_camera_position_with)
