# Dynamo custom node Dynanimate Numeric Parameter.dyf (Dynamo 0.7.5.3566)
# category: Dynanimator.ElementProperties
# Animates parameter values of a selection of elements.

Iterations = Input()
code_block = CodeBlock(n=Iterations) { 0..(n-1); }
Elements = Input()
Parameter_Name = Input()
Min_Param_Value = Input()
Max_Param_Value = Input()
dynanimatorfunction_numeric = Custom[DynanimatorFunction Numeric Parameter](Total_Iterations=Iterations, Elements=Elements, Parameter_Name=Parameter_Name, Min_Param_Value=Min_Param_Value, Max_Param_Value=Max_Param_Value)  # Helper function for Dynanimate Numeric Parameter
Directory_Path = Input()
View = Input()
dynanimatefunction_exportasimage = Custom[DynanimateFunction ExportAsImage](Directory_Path=Directory_Path, View=View, counter=Iterations)  # Exports an Image from an given view to a given directory. Uses the view as filename + a counter to number the images if necessary (will be ignored by default).
compose = ComposeFunctions(dynanimatorfunction_numeric, dynanimatefunction_exportasimage)  # "Function.Compose"
map = List.Map(code_block, compose)
Output = Output(map)  # ""
