# Dynamo custom node DynanimateFunction ExportAsImage.dyf (Dynamo 0.7.5.3566)
# category: Dynanimator.Functions
# Exports an Image from an given view to a given directory. Uses the view as filename + a counter to number the images if necessary (will be ignored by default).

View = Input()
Directory_Path = Input()
string = StringInput("\")
name = Element.Name(View)
string_2 = StringInput("_")
counter = Input()
code_block = CodeBlock(x=counter) { x; }
isNull = Object.IsNull(code_block)
string_3 = StringInput("")
string_from_object = FromObject(code_block)
if_ = If(isNull, string_3, string_from_object)
string_4 = StringInput(".png")
concat = String.Concat(Directory_Path, string, name, string_2, if_, string_4)
exportAsImage = View.ExportAsImage(View, concat)
end = Revit.Transaction.Transaction.End(exportAsImage)
func = Output(end)
