# Dynamo custom node DynanimatorFunction Camera Position With Fixed Target.dyf (Dynamo 0.7.5.3566)
# category: Dynanimator.Functions
# Helper function for Dynanimate Camera Position With Fixed Target

View = Input()
Camera_Path = Input()
Total_Iterations = Input()
Iteration = Input()
code_block = CodeBlock(n=Total_Iterations, iteration=Iteration) { 1/n*iteration; }
pointAtParameter = Curve.PointAtParameter(Camera_Path, code_block)
Target_Position = Input()
setOrientationByEyeAndTargetPosition = Custom[PerspectiveView.SetOrientationByEyeAndTargetPosition](View=View, Eye_Position=pointAtParameter, Target_Position=Target_Position)  # Sets the orientation of a given perspective view based on a given eye and target position
end = Revit.Transaction.Transaction.End(setOrientationByEyeAndTargetPosition)
Directory_Path = Input()
dynanimatorfunctionhelper = Custom[DynanimatorFunctionHelper ExportAsImage](Iteration=Iteration, Directory_Path=Directory_Path, view=View)  # Exports Current Iteration Step as Image
end_2 = Revit.Transaction.Transaction.End(dynanimatorfunctionhelper)
compose = ComposeFunctions(end, end_2)  # "Function.Compose"
