# Dynamo custom node DynanimatorFunction Element Color.dyf (Dynamo 0.7.5.3566)
# category: Dynanimator.Functions
# Helper function for Dynanimate Element Color

Elements = Input()
Start_Color = Input()
End_Color = Input()
Total_Iterations = Input()
Iteration = Input()
code_block = CodeBlock(n=Total_Iterations, iteration=Iteration) { 1/n*iteration; }
color_range = ColorRange(Start_Color, End_Color, code_block)
overrideColorInView = Element.OverrideColorInView(Elements, color_range)
end = Revit.Transaction.Transaction.End(overrideColorInView)
current = Document.Current()
activeView = Document.ActiveView(current)
Directory_Path = Input()
string = StringInput("\")
name = Element.Name(activeView)
string_2 = StringInput("_")
string_from_object = FromObject(Iteration)
string_3 = StringInput(".png")
concat = String.Concat(Directory_Path, string, name, string_2, string_from_object, string_3)
exportAsImage = View.ExportAsImage(activeView, concat)
end_2 = Revit.Transaction.Transaction.End(exportAsImage)
compose = ComposeFunctions(end, end_2)  # "Function.Compose"
