# Dynamo custom node DynanimatorFunction Element Transparency.dyf (Dynamo 0.7.5.3566)
# category: Dynanimator.Functions
# Helper function for Dynanimate Element Transparency

Elements = Input()
View = Input()
Min_Transparency = Input()  # "Min. Transparency"
Max_Transparency = Input()  # "Max. Transparency"
Total_Iterations = Input()
Iteration = Input()
code_block = CodeBlock(min=Min_Transparency, max=Max_Transparency, n=Total_Iterations, iteration=Iteration) { min + (max-min)/n*iteration; }
overrideTransparencyInView = Custom[Element.OverrideTransparencyInView](Element_s=Elements, View=View, Transparency=code_block)  # Overrides the transparency of an element in a given view
end = Revit.Transaction.Transaction.End(overrideTransparencyInView)
Directory_Path = Input()
string = StringInput("\")
name = Element.Name(View)
string_2 = StringInput("_")
string_from_object = FromObject(Iteration)
string_3 = StringInput(".png")
concat = String.Concat(Directory_Path, string, name, string_2, string_from_object, string_3)
exportAsImage = View.ExportAsImage(View, concat)
end_2 = Revit.Transaction.Transaction.End(exportAsImage)
compose = ComposeFunctions(end, end_2)  # "Function.Compose"
