# Dynamo custom node DynanimatorFunction Numeric Parameter.dyf (Dynamo 0.7.5.3566)
# category: Dynanimator.Functions
# Helper function for Dynanimate Numeric Parameter

Elements = Input()
Parameter_Name = Input()
Min_Param_Value = Input()
Max_Param_Value = Input()
Total_Iterations = Input()
Iteration = Input()
code_block = CodeBlock(min=Min_Param_Value, max=Max_Param_Value, n=Total_Iterations, iteration=Iteration) { min + (max-min)/n*iteration; }
setParameterByName = Element.SetParameterByName(Elements, Parameter_Name, code_block)
end = Revit.Transaction.Transaction.End(setParameterByName)
View = Input()
Directory_Path = Input()
string = StringInput("\")
name = Element.Name(View)
string_2 = StringInput("_")
string_from_object = FromObject(Iteration)
string_3 = StringInput(".png")
concat = String.Concat(Directory_Path, string, name, string_2, string_from_object, string_3)
exportAsImage = View.ExportAsImage(View, concat)
end_2 = Revit.Transaction.Transaction.End(exportAsImage)
compose = ComposeFunctions(end, end_2)  # "Function.Compose"
