# Dynamo custom node DynanimatorFunction Phases.dyf (Dynamo 0.7.5.3566)
# category: Dynanimator.Functions
# Helper function for Dynanimate Phases

View = Input()
Phases = Input()
Phase_Index = Input()
code_block = CodeBlock(seq=Phases, i=Phase_Index) { seq[i]; }
setPhase = Custom[View.SetPhase](View_s=View, Phase=code_block)  # Sets the phase of a given view
end = Revit.Transaction.Transaction.End(setPhase.View_s)
Directory_Path = Input()
string = StringInput("\")
name = Element.Name(View)
string_2 = StringInput("_")
name_2 = Element.Name(code_block)
string_3 = StringInput(".png")
concat = String.Concat(Directory_Path, string, name, string_2, name_2, string_3)
exportAsImage = View.ExportAsImage(View, concat)
end_2 = Revit.Transaction.Transaction.End(exportAsImage)
compose = ComposeFunctions(end, end_2)  # "Function.Compose"
