# Dynamo custom node DynanimatorFunction Target Position With Fixed Camera.dyf (Dynamo 0.7.5.3566)
# category: Dynanimator.Functions
# Helper function for Dynanimate Target Position With Fixed Camera Position

View = Input()
Camera_Position = Input()
Target_Path = Input()
Total_Iterations = Input()
Iteration = Input()
code_block = CodeBlock(n=Total_Iterations, iteration=Iteration) { 1/n*iteration; }
pointAtParameter = Curve.PointAtParameter(Target_Path, code_block)
setOrientationByEyeAndTargetPosition = Custom[PerspectiveView.SetOrientationByEyeAndTargetPosition](View=View, Eye_Position=Camera_Position, Target_Position=pointAtParameter)  # Sets the orientation of a given perspective view based on a given eye and target position
end = Revit.Transaction.Transaction.End(setOrientationByEyeAndTargetPosition)
Directory_Path = Input()
string = StringInput("\")
name = Element.Name(View)
string_2 = StringInput("_")
string_from_object = FromObject(Iteration)
string_3 = StringInput(".png")
concat = String.Concat(Directory_Path, string, name, string_2, string_from_object, string_3)
exportAsImage = View.ExportAsImage(View, concat)
end_2 = Revit.Transaction.Transaction.End(exportAsImage)
compose = ComposeFunctions(end, end_2)  # "Function.Compose"
