# Dynamo custom node DynanimatorFunctionHelper Camera And Target Position.dyf (Dynamo 0.7.5.3566)
# category: Dynanimator.Functions
# Sets the Camera and Target Position for Each Iteration Step

View = Input()
Camera_Path = Input()
Total_Iterations = Input()
Iteration = Input()
code_block = CodeBlock(n=Total_Iterations, iteration=Iteration) { 1/n*iteration; }
pointAtParameter = Curve.PointAtParameter(Camera_Path, code_block)
Target_Path = Input()
pointAtParameter_2 = Curve.PointAtParameter(Target_Path, code_block)
setOrientationByEyeAndTargetPosition = Custom[PerspectiveView.SetOrientationByEyeAndTargetPosition](View=View, Eye_Position=pointAtParameter, Target_Position=pointAtParameter_2)  # Sets the orientation of a given perspective view based on a given eye and target position
View_2 = Output(setOrientationByEyeAndTargetPosition)  # "View"
