# Dynamo custom node DynanimatorFunctionHelper Camera Position With Fixed Target.dyf (Dynamo 0.7.5.3566)
# category: Dynanimator.Functions
# Sets the Camera Position for each Iteration Step

View = Input()
Camera_Path = Input()
Total_Iterations = Input()
Iteration = Input()
code_block = CodeBlock(n=Total_Iterations, iteration=Iteration) { 1/n*iteration; }
pointAtParameter = Curve.PointAtParameter(Camera_Path, code_block)
Target_Position = Input()
setOrientationByEyeAndTargetPosition = Custom[PerspectiveView.SetOrientationByEyeAndTargetPosition](View=View, Eye_Position=pointAtParameter, Target_Position=Target_Position)  # Sets the orientation of a given perspective view based on a given eye and target position
View_2 = Output(setOrientationByEyeAndTargetPosition)  # "View"
