# Dynamo custom node DynanimatorFunctionHelper Element Color.dyf (Dynamo 0.7.5.3566)
# category: Dynanimator.Functions
# Gives back the Color for each Iteration Step

Elements = Input()
Start_Color = Input()
End_Color = Input()
Total_Iterations = Input()
Iteration = Input()
code_block = CodeBlock(n=Total_Iterations, iteration=Iteration) { 1/n*iteration; }
color_range = ColorRange(Start_Color, End_Color, code_block)
overrideColorInView = Element.OverrideColorInView(Elements, color_range)
Element = Output(overrideColorInView)
