# Dynamo custom node DynanimatorFunctionHelper Element Transparancy.dyf (Dynamo 0.7.5.3566)
# category: Dynanimator.Functions
# Gives back the Element Transparancy for each Iteration Step

Elements = Input()
View = Input()
Min_Param_Value = Input()
Max_Param_Value = Input()
Total_iterations = Input()
Iteration = Input()
code_block = CodeBlock(min=Min_Param_Value, max=Max_Param_Value, n=Total_iterations, iteration=Iteration) { min + (max-min)/n*iteration; }
overrideTransparencyInView = Custom[Element.OverrideTransparencyInView](Element_s=Elements, View=View, Transparency=code_block)  # Overrides the transparency of an element in a given view
Elements_2 = Output(overrideTransparencyInView)  # "Elements"
