# Dynamo custom node DynanimatorFunctionHelper Numeric Parameter.dyf (Dynamo 0.7.5.3566)
# category: Dynanimator.Functions
# Iterates an Element Paramter

Element = Input()
ParameterName = Input()
Min_Param_Value = Input()
Max_Param_Value = Input()
Total_Iterations = Input()
Iteration = Input()
code_block = CodeBlock(min=Min_Param_Value, max=Max_Param_Value, n=Total_Iterations, iteration=Iteration) { min + (max-min)/n*iteration; }
setParameterByName = Element.SetParameterByName(Element, ParameterName, code_block)
output = Output(setParameterByName)  # "[]"
