# Dynamo custom node DynanimatorFunctionHelper Target Position With Fixed Camera.dyf (Dynamo 0.7.5.3566)
# category: Dynanimator.Functions
# Sets the Target Position for each Iteration Step

View = Input()
Eye_Position = Input()
Target_Path = Input()
Total_Iterations = Input()
Iteration = Input()
code_block = CodeBlock(n=Total_Iterations, iteration=Iteration) { 1/n*iteration; }
pointAtParameter = Curve.PointAtParameter(Target_Path, code_block)
setOrientationByEyeAndTargetPosition = Custom[PerspectiveView.SetOrientationByEyeAndTargetPosition](View=View, Eye_Position=Eye_Position, Target_Position=pointAtParameter)  # Sets the orientation of a given perspective view based on a given eye and target position
View_2 = Output(setOrientationByEyeAndTargetPosition)  # "View"
