# Dynamo custom node DynanimatorNestedFunction Numeric Parameter And Camera Position With Fixed Target.dyf (Dynamo 0.7.5.3566)
# category: Dynanimator.Functions
# Nested function used in DynanimatorFunction Numeric Parameter And Camera Position With Fixed Target

Iteration = Input()
Total_Iterations = Input()
Elements = Input()
Parameter_Name = Input()
Min_Value = Input()
Max_Value = Input()
dynanimatorfunctionhelper = Custom[DynanimatorFunctionHelper Numeric Parameter](Iteration=Iteration, Total_Iterations=Total_Iterations, Element=Elements, ParameterName=Parameter_Name, Min_Param_Value=Min_Value, Max_Param_Value=Max_Value)  # Iterates an Element Paramter
View = Input()
Camera_Path = Input()
code_block = CodeBlock(n=Total_Iterations, iteration=Iteration) { 1/n*iteration; }
pointAtParameter = Curve.PointAtParameter(Camera_Path, code_block)
Target_Position = Input()
setOrientationByEyeAndTargetPosition = Custom[PerspectiveView.SetOrientationByEyeAndTargetPosition](View=View, Eye_Position=pointAtParameter, Target_Position=Target_Position)  # Sets the orientation of a given perspective view based on a given eye and target position
create = List.Create(dynanimatorfunctionhelper, setOrientationByEyeAndTargetPosition)
list = Output(create)
