# Dynamo custom node Dynanimate Camera And Target Position (As Image).dyf (Dynamo 0.7.5.3566)
# category: Dynanimator.ImageExport
# Animates the camera and target position of a perspective view.

Iterations = Input()
code_block = CodeBlock(n=Iterations) { 0..(n-1); }
Directory_Path = Input()
View = Input()
Camera_Path = Input()
Target_Path = Input()
dynanimatorfunction_camera_and = Custom[DynanimatorFunction Camera And Target Position](Total_Iterations=Iterations, Directory_Path=Directory_Path, View=View, Camera_Path=Camera_Path, Target_Path=Target_Path)  # Helper function for Dynanimate Camera And Target Position
map = List.Map(code_block, dynanimatorfunction_camera_and)
Output = Output(map)  # ""
