# Dynamo custom node Dynanimate Camera Position With Fixed Target (As Image).dyf (Dynamo 0.7.5.3566)
# category: Dynanimator.ImageExport
# Animates the camera of a perspective view around a fixed target.

Iterations = Input()
code_block = CodeBlock(n=Iterations) { 0..(n-1); }
Directory_Path = Input()
View = Input()
Camera_Path = Input()
Target_Position = Input()
dynanimatorfunction_camera = Custom[DynanimatorFunction Camera Position With Fixed Target](Total_Iterations=Iterations, Directory_Path=Directory_Path, View=View, Camera_Path=Camera_Path, Target_Position=Target_Position)  # Helper function for Dynanimate Camera Position With Fixed Target
map = List.Map(code_block, dynanimatorfunction_camera)
Output = Output(map)  # ""
