# Dynamo custom node Dynanimate Design Options (As Image).dyf (Dynamo 0.7.5.3566)
# category: Dynanimator.ImageExport
# Animates a list of design options in a given view.

DesignOptions = Input()
count = List.Count(DesignOptions)
code_block = CodeBlock(n=count) { 0..(n-1); }
Directory_Path = Input()
View = Input()
dynanimatorfunction_design = Custom[DynanimatorFunction Design Options (As Image)](Directory_Path=Directory_Path, View=View, Design_Options=DesignOptions)  # Helper function for Dynanimate Design Options (As Image)
map = List.Map(code_block, dynanimatorfunction_design)
Output = Output(map)  # ""
