# Dynamo custom node Dynanimate Element Color (As Image).dyf (Dynamo 0.7.5.3566)
# category: Dynanimator.ImageExport
# Animates the color of a selection of elements in the active view.

Iterations = Input()
code_block = CodeBlock(n=Iterations) { 0..(n-1); }
Directory_Path = Input()
Elements = Input()
Start_Color = Input()
End_Color = Input()
dynanimatorfunction_element = Custom[DynanimatorFunction Element Color](Total_Iterations=Iterations, Directory_Path=Directory_Path, Elements=Elements, Start_Color=Start_Color, End_Color=End_Color)  # Helper function for Dynanimate Element Color
map = List.Map(code_block, dynanimatorfunction_element)
Output = Output(map)  # ""
