# Dynamo custom node Dynanimate Element Transparency (As Image).dyf (Dynamo 0.7.5.3566)
# category: Dynanimator.ImageExport
# Animates the transparency of a selection of elements in a given view.

Iterations = Input()
code_block = CodeBlock(n=Iterations) { 0..(n-1); }
Directory_Path = Input()
View = Input()
Elements = Input()
Min_Transparency = Input()  # "Min. Transparency"
Max_Transparency = Input()  # "Max. Transparency"
dynanimatorfunction_element = Custom[DynanimatorFunction Element Transparency](Total_Iterations=Iterations, Directory_Path=Directory_Path, View=View, Elements=Elements, Min_Transparency=Min_Transparency, Max_Transparency=Max_Transparency)  # Helper function for Dynanimate Element Transparency
map = List.Map(code_block, dynanimatorfunction_element)
Output = Output(map)  # ""
