# Dynamo custom node Dynanimate Element Transparency And Camera Position With Fixed Target (As Image).dyf (Dynamo 0.7.5.3566)
# category: Dynanimator.ImageExport
# Animates the camera of a perspective view around a fixed target while gradually changing the transparency settings of selected elements.

Iterations = Input()
code_block = CodeBlock(n=Iterations) { 0..(n-1); }
Directory_Path = Input()
View = Input()
Elements = Input()
Min_Transparency = Input()  # "Min. Transparency"
Max_Transparency = Input()  # "Max. Transparency"
Camera_Path = Input()
Target_Position = Input()
dynanimatorfunction_element = Custom[DynanimatorFunction Element Transparency And Camera Position With Fixed Target](Total_Iterations=Iterations, Directory_Path=Directory_Path, View=View, Elements=Elements, Min_Transparency=Min_Transparency, Max_Transparency=Max_Transparency, Camera_Path=Camera_Path, Target_Position=Target_Position)  # Helper function for Dynanimate Element Transparency And Camera Position With Fixed Target
map = List.Map(code_block, dynanimatorfunction_element)
Output = Output(map)  # ""
