# Dynamo custom node Dynanimate Face Analysis Display (As Image).dyf (Dynamo 0.7.5.3566)
# category: Dynanimator.ImageExport
# Animates a list of face analysis results in a given view.

Samples = Input()
count = List.Count(Samples)
code_block = CodeBlock(n=count) { 0..(n-1); }
Directory_Path = Input()
View = Input()
Surface = Input()
Sample_Locations = Input()
Analysis_Display_Name = Input()
Analysis_Display_Description = Input()
Unit_Type = Input()
dynanimatorfunction = Custom[DynanimatorFunction FaceAnalysisDisplay (As Image)](Directory_Path=Directory_Path, View=View, Samples=Samples, Surface=Surface, Sample_Locations=Sample_Locations, Analysis_Display_Name=Analysis_Display_Name, Analysis_Display_Description=Analysis_Display_Description, Unit_Type=Unit_Type)  # Helper function for Dynanimate Face Analysis Display (As Image)
map = List.Map(code_block, dynanimatorfunction)
Output = Output(map)  # ""
