# Dynamo custom node Dynanimate Numeric Parameter (As Image).dyf (Dynamo 0.7.5.3566)
# category: Dynanimator.ImageExport
# Animates parameter values of a selection of elements.

Iterations = Input()
code_block = CodeBlock(n=Iterations) { 0..(n-1); }
Directory_Path = Input()
View = Input()
Elements = Input()
Parameter_Name = Input()
Min_Param_Value = Input()
Max_Param_Value = Input()
dynanimatorfunction_numeric = Custom[DynanimatorFunction Numeric Parameter](Total_Iterations=Iterations, Directory_Path=Directory_Path, View=View, Elements=Elements, Parameter_Name=Parameter_Name, Min_Param_Value=Min_Param_Value, Max_Param_Value=Max_Param_Value)  # Helper function for Dynanimate Numeric Parameter
map = List.Map(code_block, dynanimatorfunction_numeric)
Output = Output(map)  # ""
