# Dynamo custom node Dynanimate Numeric Parameter And Camera Position With Fixed Target (As Image).dyf (Dynamo 0.7.5.3566)
# category: Dynanimator.ImageExport
# Animates the camera of a perspective view around a fixed target while iterating through a list of parameter values.

Iterations = Input()
code_block = CodeBlock(n=Iterations) { 0..(n-1); }
Directory_Path = Input()
View = Input()
Elements = Input()
Parameter_Name = Input()
Min_Param_Value = Input()
Max_Param_Value = Input()
Camera_Path = Input()
Target_Position = Input()
dynanimatorfunction_numeric = Custom[DynanimatorFunction Numeric Parameter And Camera Position With Fixed Target](Total_Iterations=Iterations, Directory_Path=Directory_Path, View=View, Elements=Elements, Parameter_Name=Parameter_Name, Min_Param_Value=Min_Param_Value, Max_Param_Value=Max_Param_Value, Camera_Path=Camera_Path, Target_Position=Target_Position)  # Helper function for Dynanimate Camera Position With Fixed Target
map = List.Map(code_block, dynanimatorfunction_numeric)
Output = Output(map)  # ""
