# Dynamo custom node Dynanimate Phases (As CloudRendering).dyf (Dynamo 0.7.5.3566)
# category: Dynanimator.CloudRendering
# Animates the phases of a project in a given view.

phases = Custom[Document.Phases]()  # Retrieves all phases in the active document in *chronological* order
count = List.Count(phases)
code_block = CodeBlock(n=count) { 0..(n-1); }
View = Input()
Width = Input()
Height = Input()
RenderType = Input()
RenderQuality = Input()
emailMe = Input()
dynanimatorfunction_phases_as = Custom[DynanimatorFunction Phases (As CloudRendering)](View=View, Phases=phases, Width=Width, Height=Height, RenderType=RenderType, RenderQuality=RenderQuality, emailMe=emailMe)  # Helper function for Dynanimate Phases (As CloudRendering)
map = List.Map(code_block, dynanimatorfunction_phases_as)
Output = Output(map)  # ""
