# Dynamo custom node Dynanimate Phases (As Image).dyf (Dynamo 0.7.5.3566)
# category: Dynanimator.ImageExport
# Animates the phases of a project in a given view.

phases = Custom[Document.Phases]()  # Retrieves all phases in the active document in *chronological* order
count = List.Count(phases)
code_block = CodeBlock(n=count) { 0..(n-1); }
Directory_Path = Input()
View = Input()
dynanimatorfunction_phases = Custom[DynanimatorFunction Phases](Phases=phases, Directory_Path=Directory_Path, View=View)  # Helper function for Dynanimate Phases
map = List.Map(code_block, dynanimatorfunction_phases)
Output = Output(map)  # ""
