# Dynamo custom node Dynanimate Phases And Camera Position With Fixed Target (As Image).dyf (Dynamo 0.7.5.3566)
# category: Dynanimator.ImageExport
# Animates the camera of a perspective view around a fixed target while iterating through the phases of a project.

phases = Custom[Document.Phases]()  # Retrieves all phases in the active document in *chronological* order
Images_per_Phase = Input()
ofRepeatedItem = List.OfRepeatedItem(phases, Images_per_Phase)
transpose = List.Transpose(ofRepeatedItem)
flatten = Flatten(transpose)
count = List.Count(flatten)
code_block = CodeBlock(n=count) { 0..(n-1); }
Directory_Path = Input()
View = Input()
Camera_Path = Input()
Target_Position = Input()
dynanimatorfunction_phases_and = Custom[DynanimatorFunction Phases And Camera Position With Fixed Target](Directory_Path=Directory_Path, View=View, Phases=flatten, Camera_Path=Camera_Path, Target_Position=Target_Position)  # Helper function for Dynanimate Phases
map = List.Map(code_block, dynanimatorfunction_phases_and)
Output = Output(map)  # ""
