# Dynamo custom node Dynanimate Solar Study And Camera Position With Fixed Target (As Image).dyf (Dynamo 0.7.5.3566)
# category: Dynanimator.ImageExport
# Animates the frames of a solar study in a given view.

View = Input()
solarStudyTotalFrames = Custom[View.SolarStudyTotalFrames](View_s=View)  # Retrieves the number of frames of a solar study for a given view (if the view's sun and shadow settings are indeed set to single or multi day study)
code_block = CodeBlock(n=solarStudyTotalFrames) { 1..n; }
Directory_Path = Input()
Camera_Path = Input()
Target_Position = Input()
dynanimatorfunction_solar_study = Custom[DynanimatorFunction Solar Study And Camera Position With Fixed Target](Total_Iterations=solarStudyTotalFrames, Directory_Path=Directory_Path, View=View, Camera_Path=Camera_Path, Target_Position=Target_Position)  # Helper function for Dynanimate Solar Study And Camera Position With Fixed Target
map = List.Map(code_block, dynanimatorfunction_solar_study)
Output = Output(map)  # ""
