# Dynamo custom node Dynanimate Target Position With Fixed Camera Position (As Image).dyf (Dynamo 0.7.5.3566)
# category: Dynanimator.ImageExport
# Animates the target position of a perspective view with a fixed camera position.

Iterations = Input()
code_block = CodeBlock(n=Iterations) { 0..(n-1); }
Directory_Path = Input()
View = Input()
Camera_Position = Input()
Target_Path = Input()
dynanimatorfunction_target = Custom[DynanimatorFunction Target Position With Fixed Camera](Total_Iterations=Iterations, Directory_Path=Directory_Path, View=View, Camera_Position=Camera_Position, Target_Path=Target_Path)  # Helper function for Dynanimate Target Position With Fixed Camera Position
map = List.Map(code_block, dynanimatorfunction_target)
Output = Output(map)  # ""
