# Dynamo custom node DynanimatorFunction Camera And Target Position.dyf (Dynamo 0.7.5.3566)
# category: Dynanimator._Functions_
# Helper function for Dynanimate Camera And Target Position

Iteration = Input()
Total_Iterations = Input()
View = Input()
Camera_Path = Input()
Target_Path = Input()
dynanimatorfunctionhelper_camera = Custom[DynanimatorFunctionHelper Camera And Target Position](Iteration=Iteration, Total_Iterations=Total_Iterations, View=View, Camera_Path=Camera_Path, Target_Path=Target_Path)  # Sets the Camera and Target Position for Each Iteration Step
end = Revit.Transaction.Transaction.End(dynanimatorfunctionhelper_camera)
Directory_Path = Input()
dynanimatorfunctionhelper = Custom[DynanimatorFunctionHelper ExportAsImage](NameSuffix_opt=Iteration, Directory_Path=Directory_Path, view=View)  # Exports Current Iteration Step as Image
end_2 = Revit.Transaction.Transaction.End(dynanimatorfunctionhelper)
compose = ComposeFunctions(end, end_2)  # "Function.Compose"
