# Dynamo custom node DynanimatorFunction Camera Position With Fixed Target (As Image).dyf (Dynamo 0.7.5.3566)
# category: Dynanimator._Functions_.ImageExport
# Helper function for Dynanimate Camera Position With Fixed Target (As Image)

Iteration = Input()
Directory_Path = Input()
Total_Iterations = Input()
View = Input()
Camera_Path = Input()
Target_Position = Input()
dynanimatorfunctionhelper_camera = Custom[DynanimatorFunctionHelper Camera Position With Fixed Target](Iteration=Iteration, Total_Iterations=Total_Iterations, View=View, Camera_Path=Camera_Path, Target_Position=Target_Position)  # Sets the camera eye position for each iteration step
end = Revit.Transaction.Transaction.End(dynanimatorfunctionhelper_camera)
dynanimatorfunctionhelper = Custom[DynanimatorFunctionHelper ExportAsImage](NameSuffix_opt=Iteration, Directory_Path=Directory_Path, View=end)  # Exports current iteration step as image
func = Output(dynanimatorfunctionhelper)
