# Dynamo custom node DynanimatorFunction Camera Position With Fixed Target.dyf (Dynamo 0.7.5.3566)
# category: Dynanimator._Functions_
# Helper function for Dynanimate Camera Position With Fixed Target

Iteration = Input()
Total_Iterations = Input()
View = Input()
Camera_Path = Input()
Target_Position = Input()
dynanimatorfunctionhelper_camera = Custom[DynanimatorFunctionHelper Camera Position With Fixed Target](Iteration=Iteration, Total_Iterations=Total_Iterations, View=View, Camera_Path=Camera_Path, Target_Position=Target_Position)  # Sets the Camera Position for each Iteration Step
end = Revit.Transaction.Transaction.End(dynanimatorfunctionhelper_camera)
Directory_Path = Input()
dynanimatorfunctionhelper = Custom[DynanimatorFunctionHelper ExportAsImage](NameSuffix_opt=Iteration, Directory_Path=Directory_Path, view=View)  # Exports Current Iteration Step as Image
end_2 = Revit.Transaction.Transaction.End(dynanimatorfunctionhelper)
compose = ComposeFunctions(end, end_2)  # "Function.Compose"
