# Dynamo custom node DynanimatorFunction Design Options (As Image).dyf (Dynamo 0.7.5.3566)
# category: Dynanimator._Functions_.ImageExport
# Helper function for Dynanimate Design Options (As Image)

Design_Option_Index = Input()
Design_Options = Input()
code_block = CodeBlock(seq=Design_Options, i=Design_Option_Index) { seq[i]; }
name = Element.Name(code_block)
code_block_2 = CodeBlock(num=Design_Option_Index, desopt_name=name) { num + "_" + desopt_name; }
Directory_Path = Input()
View = Input()
setDesignOption = Custom[View.SetDesignOption](View_s=View, DesignOptions_s=code_block)  # Sets the view to a given design option. PLEASE NOTE: This node is kind of hacky. It does not use the design option settings in the visibility / graphic overrides. Instead it sets the view property "Visible in Option" to *one* specific design option - which also means that the symbolic representation of this view is only visible in views that display the given design options.
end = Revit.Transaction.Transaction.End(setDesignOption.View_s)
dynanimatorfunctionhelper = Custom[DynanimatorFunctionHelper ExportAsImage](NameSuffix_opt=code_block_2, Directory_Path=Directory_Path, View=end)  # Exports current iteration step as image
func = Output(dynanimatorfunctionhelper)
