# Dynamo custom node DynanimatorFunction Element Color (As Image).dyf (Dynamo 0.7.5.3566)
# category: Dynanimator._Functions_.ImageExport
# Helper function for Dynanimate Element Color (As Image)

Iteration = Input()
Total_Iterations = Input()
Elements = Input()
Start_Color = Input()
End_Color = Input()
dynanimatorfunctionhelper = Custom[DynanimatorFunctionHelper Element Color](Iteration=Iteration, Total_Iterations=Total_Iterations, Elements=Elements, Start_Color=Start_Color, End_Color=End_Color)  # Sets the element color for each iteration step
end = Revit.Transaction.Transaction.End(dynanimatorfunctionhelper.Iteration)
Directory_Path = Input()
current = Document.Current()
activeView = Document.ActiveView(current)
dynanimatorfunctionhelper_2 = Custom[DynanimatorFunctionHelper ExportAsImage](NameSuffix_opt=end, Directory_Path=Directory_Path, View=activeView)  # Exports current iteration step as image
func = Output(dynanimatorfunctionhelper_2)
