# Dynamo custom node DynanimatorFunction Element Color.dyf (Dynamo 0.7.5.3566)
# category: Dynanimator._Functions_
# Helper function for Dynanimate Element Color

Iteration = Input()
Total_Iterations = Input()
Elements = Input()
Start_Color = Input()
End_Color = Input()
dynanimatorfunctionhelper = Custom[DynanimatorFunctionHelper Element Color](Iteration=Iteration, Total_Iterations=Total_Iterations, Elements=Elements, Start_Color=Start_Color, End_Color=End_Color)  # Gives back the Color for each Iteration Step
end = Revit.Transaction.Transaction.End(dynanimatorfunctionhelper)
Directory_Path = Input()
current = Document.Current()
activeView = Document.ActiveView(current)
dynanimatorfunctionhelper_2 = Custom[DynanimatorFunctionHelper ExportAsImage](NameSuffix_opt=Iteration, Directory_Path=Directory_Path, view=activeView)  # Exports Current Iteration Step as Image
end_2 = Revit.Transaction.Transaction.End(dynanimatorfunctionhelper_2)
compose = ComposeFunctions(end, end_2)  # "Function.Compose"
