# Dynamo custom node DynanimatorFunction Element Transparency (As Image).dyf (Dynamo 0.7.5.3566)
# category: Dynanimator._Functions_.ImageExport
# Helper function for Dynanimate Element Transparency (As Image)

Iteration = Input()
Total_Iterations = Input()
Elements = Input()
Min_Transparency = Input()  # "Min. Transparency"
Max_Transparency = Input()  # "Max. Transparency"
View = Input()
dynanimatorfunctionhelper = Custom[DynanimatorFunctionHelper Element Transparency](Iteration=Iteration, Total_iterations=Total_Iterations, Elements=Elements, Min_Transparency=Min_Transparency, Max_Transparency=Max_Transparency, View=View)  # Sets the element transparency for each iteration step
end = Revit.Transaction.Transaction.End(dynanimatorfunctionhelper.Iteration)
Directory_Path = Input()
dynanimatorfunctionhelper_2 = Custom[DynanimatorFunctionHelper ExportAsImage](NameSuffix_opt=end, Directory_Path=Directory_Path, View=View)  # Exports current iteration step as image
func = Output(dynanimatorfunctionhelper_2)
