# Dynamo custom node DynanimatorFunction Element Transparency.dyf (Dynamo 0.7.5.3566)
# category: Dynanimator._Functions_
# Helper function for Dynanimate Element Transparency

Iteration = Input()
Total_Iterations = Input()
Elements = Input()
Min_Transparency = Input()  # "Min. Transparency"
Max_Transparency = Input()  # "Max. Transparency"
View = Input()
dynanimatorfunctionhelper = Custom[DynanimatorFunctionHelper Element Transparancy](Iteration=Iteration, Total_iterations=Total_Iterations, Elements=Elements, Min_Param_Value=Min_Transparency, Max_Param_Value=Max_Transparency, View=View)  # Gives back the Element Transparancy for each Iteration Step
end = Revit.Transaction.Transaction.End(dynanimatorfunctionhelper)
Directory_Path = Input()
dynanimatorfunctionhelper_2 = Custom[DynanimatorFunctionHelper ExportAsImage](NameSuffix_opt=Iteration, Directory_Path=Directory_Path, view=View)  # Exports Current Iteration Step as Image
end_2 = Revit.Transaction.Transaction.End(dynanimatorfunctionhelper_2)
compose = ComposeFunctions(end, end_2)  # "Function.Compose"
