# Dynamo custom node DynanimatorFunction Face Analysis Display (As Image).dyf (Dynamo 0.7.5.3566)
# category: Dynanimator._Functions_.ImageExport
# Helper function for Dynanimate Face Analysis Display (As Image)

Samples_Index = Input()
string_from_object = FromObject(Samples_Index)
Directory_Path = Input()
View = Input()
Surface = Input()
Sample_Locations = Input()
Samples = Input()
code_block = CodeBlock(seq=Samples, i=Samples_Index) { seq[i]; }
Analysis_Display_Name = Input()
Analysis_Display_Description = Input()
Unit_Type = Input()
dynanimatorfunctionhelper = Custom[DynanimatorFunctionHelper FaceAnalysisDisplay](View=View, Surface=Surface, SampleLocations=Sample_Locations, Samples=code_block, Name=Analysis_Display_Name, Description=Analysis_Display_Description, UnitType=Unit_Type)  # Updates the face analysis display for each iteration step
end = Revit.Transaction.Transaction.End(dynanimatorfunctionhelper.View)
dynanimatorfunctionhelper_2 = Custom[DynanimatorFunctionHelper ExportAsImage](NameSuffix_opt=string_from_object, Directory_Path=Directory_Path, View=end)  # Exports current iteration step as image
func = Output(dynanimatorfunctionhelper_2)
