# Dynamo custom node DynanimatorFunction Numeric Parameter (As Image).dyf (Dynamo 0.7.5.3566)
# category: Dynanimator._Functions_.ImageExport
# Helper function for Dynanimate Numeric Parameter (As Image)

Iteration = Input()
Total_Iterations = Input()
Elements = Input()
Parameter_Name = Input()
Min_Param_Value = Input()
Max_Param_Value = Input()
dynanimatorfunctionhelper = Custom[DynanimatorFunctionHelper Numeric Parameter](Iteration=Iteration, Total_Iterations=Total_Iterations, Element=Elements, ParameterName=Parameter_Name, Min_Param_Value=Min_Param_Value, Max_Param_Value=Max_Param_Value)  # Sets a parameter value for each iteration step
end = Revit.Transaction.Transaction.End(dynanimatorfunctionhelper.Iteration)
Directory_Path = Input()
View = Input()
dynanimatorfunctionhelper_2 = Custom[DynanimatorFunctionHelper ExportAsImage](NameSuffix_opt=end, Directory_Path=Directory_Path, View=View)  # Exports current iteration step as image
func = Output(dynanimatorfunctionhelper_2)
