# Dynamo custom node DynanimatorFunction Numeric Parameter And Camera Position With Fixed Target.dyf (Dynamo 0.7.5.3566)
# category: Dynanimator._Functions_
# Helper function for Dynanimate Camera Position With Fixed Target

Iteration = Input()
Total_Iterations = Input()
View = Input()
Elements = Input()
Parameter_Name = Input()
Min_Param_Value = Input()
Max_Param_Value = Input()
Camera_Path = Input()
Target_Position = Input()
dynanimatornestedfunction = Custom[DynanimatorNestedFunction Numeric Parameter And Camera Position With Fixed Target](Iteration=Iteration, Total_Iterations=Total_Iterations, View=View, Elements=Elements, Parameter_Name=Parameter_Name, Min_Value=Min_Param_Value, Max_Value=Max_Param_Value, Camera_Path=Camera_Path, Target_Position=Target_Position)  # Nested function used in DynanimatorFunction Numeric Parameter And Camera Position With Fixed Target
end = Revit.Transaction.Transaction.End(dynanimatornestedfunction)
Directory_Path = Input()
dynanimatorfunctionhelper = Custom[DynanimatorFunctionHelper ExportAsImage](NameSuffix_opt=Iteration, Directory_Path=Directory_Path, view=View)  # Exports Current Iteration Step as Image
end_2 = Revit.Transaction.Transaction.End(dynanimatorfunctionhelper)
compose = ComposeFunctions(end, end_2)  # "Function.Compose"
