# Dynamo custom node DynanimatorFunction Numeric Parameter.dyf (Dynamo 0.7.5.3566)
# category: Dynanimator._Functions_
# Helper function for Dynanimate Numeric Parameter

Iteration = Input()
Total_Iterations = Input()
Elements = Input()
Parameter_Name = Input()
Min_Param_Value = Input()
Max_Param_Value = Input()
dynanimatorfunctionhelper = Custom[DynanimatorFunctionHelper Numeric Parameter](Iteration=Iteration, Total_Iterations=Total_Iterations, Element=Elements, ParameterName=Parameter_Name, Min_Param_Value=Min_Param_Value, Max_Param_Value=Max_Param_Value)  # Iterates an Element Paramter
end = Revit.Transaction.Transaction.End(dynanimatorfunctionhelper)
Directory_Path = Input()
View = Input()
dynanimatorfunctionhelper_2 = Custom[DynanimatorFunctionHelper ExportAsImage](NameSuffix_opt=Iteration, Directory_Path=Directory_Path, view=View)  # Exports Current Iteration Step as Image
end_2 = Revit.Transaction.Transaction.End(dynanimatorfunctionhelper_2)
compose = ComposeFunctions(end, end_2)  # "Function.Compose"
