# Dynamo custom node DynanimatorFunction Phases (As CloudRendering).dyf (Dynamo 0.7.5.3566)
# category: Dynanimator._Functions_.CloudRendering
# Helper function for Dynanimate Phases (As CloudRendering)

Phase_Index = Input()
string = StringInput("_")
Phases = Input()
code_block = CodeBlock(seq=Phases, i=Phase_Index) { seq[i]; }
name = Element.Name(code_block)
concat = String.Concat(Phase_Index, string, name, string)
View = Input()
setPhase = Custom[View.SetPhase](View_s=View, Phase=code_block)  # Sets the phase of a given view
end = Revit.Transaction.Transaction.End(setPhase.View_s)
Width = Input()
Height = Input()
RenderType = Input()
RenderQuality = Input()
emailMe = Input()
dynanimatorfunctionhelper = Custom[DynanimatorFunctionHelper CloudRender](NameSuffix_opt=concat, View=end, Width=Width, Height=Height, RenderType=RenderType, RenderQuality=RenderQuality, emailMe=emailMe)  # "DynanimatorFunctionHelper ExportAsCloudRendering"; Renders current iteration step in the cloud (Credits required)
func = Output(dynanimatorfunctionhelper)
