# Dynamo custom node DynanimatorFunction Phases (As Image).dyf (Dynamo 0.7.5.3566)
# category: Dynanimator._Functions_.ImageExport
# Helper function for Dynanimate Phases (As Image)

Phase_Index = Input()
Phases = Input()
code_block = CodeBlock(seq=Phases, i=Phase_Index) { seq[i]; }
name = Element.Name(code_block)
code_block_2 = CodeBlock(num=Phase_Index, phase_name=name) { num + "_" + phase_name; }
Directory_Path = Input()
View = Input()
setPhase = Custom[View.SetPhase](View_s=View, Phase=code_block)  # Sets the phase of a given view
end = Revit.Transaction.Transaction.End(setPhase.View_s)
dynanimatorfunctionhelper = Custom[DynanimatorFunctionHelper ExportAsImage](NameSuffix_opt=code_block_2, Directory_Path=Directory_Path, View=end)  # Exports current iteration step as image
func = Output(dynanimatorfunctionhelper)
