# Dynamo custom node DynanimatorFunction Phases And Camera Position With Fixed Target (As Image).dyf (Dynamo 0.7.5.3566)
# category: Dynanimator._Functions_.ImageExport
# Helper function for Dynanimate Phases (As Image)

Phase_Index = Input()
Phases = Input()
code_block = CodeBlock(seq=Phases, i=Phase_Index) { seq[i]; }
name = Element.Name(code_block)
code_block_2 = CodeBlock(num=Phase_Index, phase_name=name) { num + "_" + phase_name; }
Directory_Path = Input()
count = List.Count(Phases)
View = Input()
setPhase = Custom[View.SetPhase](View_s=View, Phase=code_block)  # Sets the phase of a given view
Camera_Path = Input()
Target_Position = Input()
dynanimatorfunctionhelper_camera = Custom[DynanimatorFunctionHelper Camera Position With Fixed Target](Iteration=Phase_Index, Total_Iterations=count, View=setPhase.View_s, Camera_Path=Camera_Path, Target_Position=Target_Position)  # Sets the camera eye position for each iteration step
end = Revit.Transaction.Transaction.End(dynanimatorfunctionhelper_camera)
dynanimatorfunctionhelper = Custom[DynanimatorFunctionHelper ExportAsImage](NameSuffix_opt=code_block_2, Directory_Path=Directory_Path, View=end)  # Exports current iteration step as image
func = Output(dynanimatorfunctionhelper)
