# Dynamo custom node DynanimatorFunction Phases And Camera Position With Fixed Target.dyf (Dynamo 0.7.5.3566)
# category: Dynanimator._Functions_
# Helper function for Dynanimate Phases

Phase_Index = Input()
Phases = Input()
count = List.Count(Phases)
View = Input()
code_block = CodeBlock(seq=Phases, i=Phase_Index) { seq[i]; }
Camera_Path = Input()
Target_Position = Input()
dynanimatorfunctionhelper_phases = Custom[DynanimatorNestedFunction Phase And Camera Position With Fixed Target](Iteration=Phase_Index, Total_Iterations=count, View=View, Phase=code_block, Camera_Path=Camera_Path, Target_Position=Target_Position)  # "DynanimatorFunctionHelper Phases And Camera Position With Fixed Target"; Sets the current phase of a view and its camera eye position for each iteration step
end = Revit.Transaction.Transaction.End(dynanimatorfunctionhelper_phases)
name = Element.Name(code_block)
code_block_2 = CodeBlock(num=Phase_Index, phase_name=name) { num + "_" + phase_name; }
Directory_Path = Input()
dynanimatorfunctionhelper = Custom[DynanimatorFunctionHelper ExportAsImage](NameSuffix_opt=code_block_2, Directory_Path=Directory_Path, View=View)  # Exports current iteration step as image
end_2 = Revit.Transaction.Transaction.End(dynanimatorfunctionhelper)
compose = ComposeFunctions(end, end_2)  # "Function.Compose"
