# Dynamo custom node DynanimatorFunction Phases.dyf (Dynamo 0.7.5.3566)
# category: Dynanimator._Functions_
# Helper function for Dynanimate Phases

View = Input()
Phases = Input()
Phase_Index = Input()
code_block = CodeBlock(seq=Phases, i=Phase_Index) { seq[i]; }
setPhase = Custom[View.SetPhase](View_s=View, Phase=code_block)  # Sets the phase of a given view
end = Revit.Transaction.Transaction.End(setPhase.View_s)
name = Element.Name(code_block)
code_block_2 = CodeBlock(num=Phase_Index, phase_name=name) { num + "_" + phase_name; }
Directory_Path = Input()
dynanimatorfunctionhelper = Custom[DynanimatorFunctionHelper ExportAsImage](NameSuffix_opt=code_block_2, Directory_Path=Directory_Path, view=View)  # Exports Current Iteration Step as Image
end_2 = Revit.Transaction.Transaction.End(dynanimatorfunctionhelper)
compose = ComposeFunctions(end, end_2)  # "Function.Compose"
