# Dynamo custom node DynanimatorFunction Solar Study (As Image).dyf (Dynamo 0.7.5.3566)
# category: Dynanimator._Functions_.ImageExport
# Helper function for Dynanimate Solar Study (As Image)

Iteration = Input()
Directory_Path = Input()
View = Input()
setSolarStudyActiveFrameNumber = Custom[View.SetSolarStudyActiveFrameNumber](View=View, Frame_number=Iteration)  # Sets the active frame number of the solar study in a given view
end = Revit.Transaction.Transaction.End(setSolarStudyActiveFrameNumber.View)
dynanimatorfunctionhelper = Custom[DynanimatorFunctionHelper ExportAsImage](NameSuffix_opt=Iteration, Directory_Path=Directory_Path, View=end)  # Exports current iteration step as image
func = Output(dynanimatorfunctionhelper)
