# Dynamo custom node DynanimatorFunction Target Position With Fixed Camera (As Image).dyf (Dynamo 0.7.5.3566)
# category: Dynanimator._Functions_.ImageExport
# Helper function for Dynanimate Target Position With Fixed Camera Position (As Image)

Iteration = Input()
Directory_Path = Input()
Total_Iterations = Input()
View = Input()
Camera_Position = Input()
Target_Path = Input()
dynanimatorfunctionhelper_target = Custom[DynanimatorFunctionHelper Target Position With Fixed Camera](Iteration=Iteration, Total_Iterations=Total_Iterations, View=View, Eye_Position=Camera_Position, Target_Path=Target_Path)  # Sets the camera target position for each iteration step
end = Revit.Transaction.Transaction.End(dynanimatorfunctionhelper_target)
dynanimatorfunctionhelper = Custom[DynanimatorFunctionHelper ExportAsImage](NameSuffix_opt=Iteration, Directory_Path=Directory_Path, View=end)  # Exports current iteration step as image
func = Output(dynanimatorfunctionhelper)
