# Dynamo custom node DynanimatorFunction Target Position With Fixed Camera.dyf (Dynamo 0.7.5.3566)
# category: Dynanimator._Functions_
# Helper function for Dynanimate Target Position With Fixed Camera Position

Iteration = Input()
Total_Iterations = Input()
View = Input()
Camera_Position = Input()
Target_Path = Input()
dynanimatorfunctionhelper_target = Custom[DynanimatorFunctionHelper Target Position With Fixed Camera](Iteration=Iteration, Total_Iterations=Total_Iterations, View=View, Eye_Position=Camera_Position, Target_Path=Target_Path)  # Sets the Target Position for each Iteration Step
end = Revit.Transaction.Transaction.End(dynanimatorfunctionhelper_target)
Directory_Path = Input()
dynanimatorfunctionhelper = Custom[DynanimatorFunctionHelper ExportAsImage](NameSuffix_opt=Iteration, Directory_Path=Directory_Path, view=View)  # Exports Current Iteration Step as Image
end_2 = Revit.Transaction.Transaction.End(dynanimatorfunctionhelper)
compose = ComposeFunctions(end, end_2)  # "Function.Compose"
