# Dynamo custom node DynanimatorFunctionHelper Camera And Target Position.dyf (Dynamo 0.7.5.3566)
# category: Dynanimator._Helpers_.ModelAlteration
# Sets the camera eye and target position for each iteration step

View = Input()
Camera_Path = Input()
Total_Iterations = Input()
Iteration = Input()
code_block = CodeBlock(n=Total_Iterations, iteration=Iteration) { 1/(n-1)*iteration; }
pointAtParameter = Curve.PointAtParameter(Camera_Path, code_block)
Target_Path = Input()
pointAtParameter_2 = Curve.PointAtParameter(Target_Path, code_block)
orientToEyeAndTargetPosition = Custom[PerspectiveView.SetOrientationByEyeAndTargetPosition](View=View, Eye_Position=pointAtParameter, Target_Position=pointAtParameter_2)  # "PerspectiveView.OrientToEyeAndTargetPosition"; Sets the orientation of a given perspective view based on a given eye and target position
View_2 = Output(orientToEyeAndTargetPosition)  # "View"
