# Dynamo custom node DynanimatorFunctionHelper Camera Position With Fixed Target.dyf (Dynamo 0.7.5.3566)
# category: Dynanimator._Helpers_.ModelAlteration
# Sets the camera eye position for each iteration step

View = Input()
Camera_Path = Input()
Total_Iterations = Input()
Iteration = Input()
code_block = CodeBlock(n=Total_Iterations, iteration=Iteration) { 1/(n-1)*iteration; }
pointAtParameter = Curve.PointAtParameter(Camera_Path, code_block)
Target_Position = Input()
orientToEyeAndTargetPosition = Custom[PerspectiveView.SetOrientationByEyeAndTargetPosition](View=View, Eye_Position=pointAtParameter, Target_Position=Target_Position)  # "PerspectiveView.OrientToEyeAndTargetPosition"; Sets the orientation of a given perspective view based on a given eye and target position
View_2 = Output(orientToEyeAndTargetPosition)  # "View"
