# Dynamo custom node DynanimatorFunctionHelper Element Color.dyf (Dynamo 0.7.5.3566)
# category: Dynanimator._Helpers_.ModelAlteration
# Sets the element color for each iteration step

Elements = Input()
Start_Color = Input()
End_Color = Input()
Total_Iterations = Input()
Iteration = Input()
code_block = CodeBlock(n=Total_Iterations, iteration=Iteration) { 1/(n-1)*iteration; }
color_range = ColorRange(Start_Color, End_Color, code_block)
overrideColorInView = Element.OverrideColorInView(Elements, color_range)
Elements_2 = Output(overrideColorInView)  # "Elements"
Iteration_2 = Output(Iteration)  # "Iteration"
