# Dynamo custom node DynanimatorFunctionHelper Element Transparency.dyf (Dynamo 0.7.5.3566)
# category: Dynanimator._Helpers_.ModelAlteration
# Sets the element transparency for each iteration step

Elements = Input()
View = Input()
Min_Transparency = Input()
Max_Transparency = Input()
Total_iterations = Input()
Iteration = Input()
code_block = CodeBlock(min=Min_Transparency, max=Max_Transparency, n=Total_iterations, iteration=Iteration) { min + (max-min)/(n-1)*iteration; }
overrideTransparencyInView = Custom[Element.OverrideTransparencyInView](Element_s=Elements, View=View, Transparency=code_block)  # Overrides the transparency of an element in a given view
Elements_2 = Output(overrideTransparencyInView)  # "Elements"
Iteration_2 = Output(Iteration)  # "Iteration"
