# Dynamo custom node DynanimatorFunctionHelper ExportAsCloudRendering.dyf (Dynamo 0.7.5.3566)
# category: Dynanimator._Helpers_.Export
# Renders current iteration step in the cloud (Credits required)

View = Input()
export_cloud_render_data = ExportDocumentRenderData(View)
upload_cloud_render_data = UploadRenderData(export_cloud_render_data)
name = Element.Name(View)
string = StringInput("_")
NameSuffix_opt = Input()  # "NameSuffix (opt)"
code_block = CodeBlock(num=NameSuffix_opt) { num; }
isNull = Object.IsNull(code_block)
string_2 = StringInput("")
if_ = If(isNull, string_2, code_block)
string_from_object = FromObject(if_)
concat = String.Concat(name, string, string_from_object)
Width = Input()
Height = Input()
RenderType = Input()
RenderQuality = Input()
byViewNameWidthHeight = Analyze.Render.CloudRenderingJob.ByViewNameWidthHeight(concat, Width, Height, RenderType, RenderQuality)
emailMe = Input()
do_cloud_render = CloudRender(upload_cloud_render_data, byViewNameWidthHeight, emailMe)
Image_Location = Output(do_cloud_render)
