# Dynamo custom node DynanimatorFunctionHelper ExportAsImage.dyf (Dynamo 0.7.5.3566)
# category: Dynanimator._Helpers_.Export
# Exports current iteration step as image

View = Input()
Directory_Path = Input()
string = StringInput("\")
name = Element.Name(View)
string_2 = StringInput("_")
NameSuffix_opt = Input()  # "NameSuffix (opt)"
code_block = CodeBlock(num=NameSuffix_opt) { num; }
isNull = Object.IsNull(code_block)
string_3 = StringInput("")
if_ = If(isNull, string_3, code_block)
string_from_object = FromObject(if_)
string_4 = StringInput(".png")
concat = String.Concat(Directory_Path, string, name, string_2, string_from_object, string_4)
exportAsImage = View.ExportAsImage(View, concat)
output = Output(exportAsImage)  # "[]"
