# Dynamo custom node DynanimatorFunctionHelper Face Analysis Display.dyf (Dynamo 0.7.5.3566)
# category: Dynanimator._Helpers_.ModelAlteration
# Updates the face analysis display for each iteration step

View = Input()
Surface = Input()
SampleLocations = Input()
Samples = Input()
Name = Input()
Description = Input()
UnitType = Input()
byViewFacePointsAndValues = Revit.AnalysisDisplay.FaceAnalysisDisplay.ByViewFacePointsAndValues(View, Surface, SampleLocations, Samples, Name, Description, UnitType)
FaceAnalysisDisplay = Output(byViewFacePointsAndValues)
View_2 = Output(View)  # "View"
