# Dynamo custom node DynanimatorFunctionHelper Numeric Parameter And Camera Position With Fixed Target.dyf (Dynamo 0.7.5.3566)
# category: Dynanimator._Helpers_
# Sets the parameter value and the camera eye and target position for each iteration step

Iteration = Input()
Total_Iterations = Input()
Elements = Input()
Parameter_Name = Input()
Min_Value = Input()
Max_Value = Input()
dynanimatorfunctionhelper = Custom[DynanimatorFunctionHelper Numeric Parameter](Iteration=Iteration, Total_Iterations=Total_Iterations, Element=Elements, ParameterName=Parameter_Name, Min_Param_Value=Min_Value, Max_Param_Value=Max_Value)  # Sets a parameter value for each iteration step
View = Input()
Camera_Path = Input()
Target_Position = Input()
dynanimatorfunctionhelper_camera = Custom[DynanimatorFunctionHelper Camera Position With Fixed Target](Iteration=Iteration, Total_Iterations=Total_Iterations, View=View, Camera_Path=Camera_Path, Target_Position=Target_Position)  # Sets the camera eye position for each iteration step
create = List.Create(dynanimatorfunctionhelper, dynanimatorfunctionhelper_camera)
list = Output(create)
