# Dynamo custom node DynanimatorFunctionHelper Numeric Parameter.dyf (Dynamo 0.7.5.3566)
# category: Dynanimator._Helpers_.ModelAlteration
# Sets a parameter value for each iteration step

Element = Input()
ParameterName = Input()
Min_Param_Value = Input()
Max_Param_Value = Input()
Total_Iterations = Input()
Iteration = Input()
code_block = CodeBlock(min=Min_Param_Value, max=Max_Param_Value, n=Total_Iterations, iteration=Iteration) { min + (max-min)/(n-1)*iteration; }
setParameterByName = Element.SetParameterByName(Element, ParameterName, code_block)
Elements = Output(setParameterByName)
Iteration_2 = Output(Iteration)  # "Iteration"
