# Dynamo custom node DynanimatorFunctionHelper Phases And Camera Position With Fixed Target.dyf (Dynamo 0.7.5.3566)
# category: Dynanimator._Helpers_
# Sets the current phase of a view and its camera eye position for each iteration step

View = Input()
Phase = Input()
setPhase = Custom[View.SetPhase](View_s=View, Phase=Phase)  # Sets the phase of a given view
Iteration = Input()
Total_Iterations = Input()
Camera_Path = Input()
Target_Position = Input()
dynanimatorfunctionhelper_camera = Custom[DynanimatorFunctionHelper Camera Position With Fixed Target](Iteration=Iteration, Total_Iterations=Total_Iterations, View=View, Camera_Path=Camera_Path, Target_Position=Target_Position)  # Sets the camera eye position for each iteration step
create = List.Create(setPhase.View_s, dynanimatorfunctionhelper_camera)
list = Output(create)
