# Dynamo custom node DynanimatorFunctionHelper Target Position With Fixed Camera.dyf (Dynamo 0.7.5.3566)
# category: Dynanimator._Helpers_.ModelAlteration
# Sets the camera target position for each iteration step

View = Input()
Eye_Position = Input()
Target_Path = Input()
Total_Iterations = Input()
Iteration = Input()
code_block = CodeBlock(n=Total_Iterations, iteration=Iteration) { 1/(n-1)*iteration; }
pointAtParameter = Curve.PointAtParameter(Target_Path, code_block)
orientToEyeAndTargetPosition = Custom[PerspectiveView.SetOrientationByEyeAndTargetPosition](View=View, Eye_Position=Eye_Position, Target_Position=pointAtParameter)  # "PerspectiveView.OrientToEyeAndTargetPosition"; Sets the orientation of a given perspective view based on a given eye and target position
View_2 = Output(orientToEyeAndTargetPosition)  # "View"
