# Dynamo graph Phases.dyn (Dynamo 0.7.5.3566)

views = Views("From Yard")
code_block = CodeBlock { 1280; }
code_block_2 = CodeBlock { 720; }
select_rendertype = RenderTypeDropDown("Image")
select_renderquality = RenderQualityDropDown("High")
boolean = BoolSelector(false)
dynanimate_phases_as = Custom[Dynanimate Phases (As CloudRendering)](View=views, Width=code_block, Height=code_block_2, RenderType=select_rendertype, RenderQuality=select_renderquality, emailMe=boolean)  # Animates the phases of a project in a given view.
