# Dynamo graph Design Options.dyn (Dynamo 0.7.5.3566)

directory_path = Directory("C:\temp")
views = Views("From Yard")
designOptions = Custom[Document.DesignOptions]()  # Returns all design options in the model, grouped by design option set
code_block = CodeBlock { "People"; }
element_name_universal = Custom[Element.Name (Universal)](Element_s=designOptions.DesignOptionSets)  # Gets an element's name (Dynamo's built-in Name nodes don't work for all element types, e.g. worksets...)
eq = code_block == element_name_universal
filterByBoolMask = List.FilterByBoolMask(designOptions.DesignOptions, eq)
flatten = Flatten(filterByBoolMask)
dynanimate_design_options_as = Custom[Dynanimate Design Options (As Image)](Directory_Path=directory_path, View=views, DesignOptions=flatten)  # Animates all design options contained in a given option set of a project in a given view.
