# Dynamo graph Element Transparency And Camera Position With Fixed Target.dyn (Dynamo 0.7.5.3566)

integer_slider = IntegerSlider(10, range=0..100)
directory_path = Directory("C:\temp")
views = Views("Animation View (Unlocked)")
select_model_elements = DSModelElementsSelection()  # 2 picked in the model
code_block = CodeBlock { 0; 100; }
select_model_element = DSModelElementSelection()  # 1 picked in the model
geometry = Element.Geometry(select_model_element)
firstItem = List.FirstItem(geometry)
select_model_element_2 = DSModelElementSelection()  # 1 picked in the model
geometry_2 = Element.Geometry(select_model_element_2)
byUnion = Solid.ByUnion(geometry_2)
centroid = Solid.Centroid(byUnion)
dynanimate_element_transparency = Custom[Dynanimate Element Transparency And Camera Position With Fixed Target (As Image)](Iterations=integer_slider, Directory_Path=directory_path, View=views, Elements=select_model_elements, Min_Transparency=code_block.out0, Max_Transparency=code_block.out1, Camera_Path=firstItem, Target_Position=centroid)  # Animates the camera of a perspective view around a fixed target while gradually changing the transparency settings of selected elements.
