# Dynamo graph Element Transparency.dyn (Dynamo 0.7.5.3566)

integer_slider = IntegerSlider(10, range=0..100)
directory_path = Directory("C:\temp")
views = Views("From Yard")
select_model_elements = DSModelElementsSelection()  # 2 picked in the model
code_block = CodeBlock { 0; 90; }
dynanimate_element_transparency = Custom[Dynanimate Element Transparency](Iterations=integer_slider, Directory_Path=directory_path, View=views, Elements=select_model_elements, Min_Transparency=code_block.out0, Max_Transparency=code_block.out1)  # Animates the transparency of a selection of elements in a given view.
