# Dynamo graph Face Analysis Display.dyn (Dynamo 0.7.5.3566)

string = StringInput(";")
file_path_sample_coordinates = Filename("C:\Users\adieckmann\Documents\GitHub\Dynanimator\package\extra\SampleCoordinates.csv")
fromPath = FileObject(file_path_sample_coordinates)  # "File.FromPath"
readText = File.ReadText(fromPath)
boolean = BoolSelector(false)
boolean_2 = BoolSelector(true)
fromCSV = Custom[List.FromCSV](delimiter=string, CSV_string=readText, ignore_last_column=boolean, ignore_first_row=boolean_2, ignore_last_row=boolean)  # Converts the content of a given CSV file to a list
transpose = List.Transpose(fromCSV)
firstItem = List.FirstItem(transpose)
directory_path = Directory("C:\Users\adieckmann\Desktop")
views = Views("Level 2")
file_path_sample_analysis_data = Filename("C:\Users\adieckmann\Documents\GitHub\Dynanimator\package\extra\SampleAnalysisData.csv")
fromPath_2 = FileObject(file_path_sample_analysis_data)  # "File.FromPath"
readText_2 = File.ReadText(fromPath_2)
fromCSV_2 = Custom[List.FromCSV](delimiter=string, CSV_string=readText_2, ignore_last_column=boolean, ignore_first_row=boolean_2, ignore_last_row=boolean)
transpose_2 = List.Transpose(fromCSV_2)
code_block = CodeBlock { 1; }
groupListOfListsByKey = Custom[List.GroupListOfListsByKey](list=transpose_2, key_index=code_block)  # Groups a list of lists by one of its keys
code_block_2 = CodeBlock { 2; }
getItemAtIndex = List.GetItemAtIndex(arg1=code_block_2)
map = List.Map(groupListOfListsByKey, getItemAtIndex)
toNumber = String.ToNumber(map)
select_face = DSFaceSelection()  # 1 picked in the model
firstItem_2 = List.FirstItem(select_face)
code_block_3 = CodeBlock(seq=transpose) { seq[1]; seq[2]; seq[3]; }
toNumber_2 = String.ToNumber(code_block_3.out0)
toNumber_3 = String.ToNumber(code_block_3.out1)
toNumber_4 = String.ToNumber(code_block_3.out2)
byCoordinates = Point.ByCoordinates(toNumber_2, toNumber_3, toNumber_4)
UVParameterAtPoint = Surface.UVParameterAtPoint(firstItem_2, byCoordinates)
code_block_4 = CodeBlock { "DynanimatorAnalysisTest"; "A test to prototype animations of analysis data in Revit"; }
unit_types = UnitTypes("Length")
dynanimate_faceanalysisdisplay = Custom[Dynanimate FaceAnalysisDisplay (As Image)](Directory_Path=directory_path, View=views, Samples=toNumber, Surface=firstItem_2, Sample_Locations=UVParameterAtPoint, Analysis_Display_Name=code_block_4.out0, Analysis_Display_Description=code_block_4.out1, Unit_Type=unit_types)  # Animates a list of design options in a given view.
