# Dynamo graph Numeric Parameter And Camera Position With Fixed Target.dyn (Dynamo 0.7.5.3566)

iterations = IntegerSlider(10, range=0..300)
directory_path = Directory("C:\temp")
views = Views("Animation View (Unlocked)")
family_types = FamilyTypes("Single Window:Standard")
all_elements_of_family_type = ElementsOfFamilyType(family_types)
parameter_name = CodeBlock { "Height"; }
code_block = CodeBlock()
# ---------- code_block.designscript (8 lines) ----------
// Depending on which Dynamo version you are running you may need to significantly alter these parameter values.
// In Dynamo 0.7.x set these values to imperial units (or convert them to imperial units before sending them to the Dynanimate node), e.g. Min = 2 ft, Max = 6.5 ft
// In Dynamo 0.8.x set these values according to the unit settings of your Revit project, e.g. Min = 1200 mm, Max = 2700 mm

// Min. parameter value
2;
// Max. parameter value
6.5;
# ----------------------------------------
camera_path_curve = DSModelElementSelection()  # 1 picked in the model
geometry = Element.Geometry(camera_path_curve)
firstItem = List.FirstItem(geometry)
select_model_element = DSModelElementSelection()  # 1 picked in the model
geometry_2 = Element.Geometry(select_model_element)
byUnion = Solid.ByUnion(geometry_2)
centroid = Solid.Centroid(byUnion)
dynanimate_numeric_parameter_and = Custom[Dynanimate Numeric Parameter And Camera Position With Fixed Target](Iterations=iterations, Directory_Path=directory_path, View=views, Elements=all_elements_of_family_type, Parameter_Name=parameter_name, Min_Param_Value=code_block.out0, Max_Param_Value=code_block.out1, Camera_Path=firstItem, Target_Position=centroid)  # "Dynanimate Numeric Parameter And Camera Position With Fixed Target (As Image)"; Animates the camera of a perspective view around a fixed target.
