# Dynamo graph Phases And Camera Position With Fixed Target.dyn (Dynamo 0.7.5.3566)

directory_path = Directory("C:\temp")
views = Views("Animation View (Unlocked)")
integer_slider = IntegerSlider(3, range=0..100)
select_model_element = DSModelElementSelection()  # 1 picked in the model
geometry = Element.Geometry(select_model_element)
firstItem = List.FirstItem(geometry)
select_model_element_2 = DSModelElementSelection()  # 1 picked in the model
geometry_2 = Element.Geometry(select_model_element_2)
byUnion = Solid.ByUnion(geometry_2)
centroid = Solid.Centroid(byUnion)
dynanimate_phases_and_camera = Custom[Dynanimate Phases And Camera Position With Fixed Target](Directory_Path=directory_path, View=views, Images_per_Phase=integer_slider, Camera_Path=firstItem, Target_Path=centroid)  # Animates the phases of a project in a given view.
