# Dynamo graph Target Position With Fixed Camera.dyn (Dynamo 0.7.5.3566)

integer_slider = IntegerSlider(10, range=0..100)
directory_path = Directory("C:\temp")
views = Views("Animation View (Unlocked)")
select_model_element = DSModelElementSelection()  # 1 picked in the model
geometry = Element.Geometry(select_model_element)
firstItem = List.FirstItem(geometry)
code_block = CodeBlock { 0.5; }
pointAtParameter = Curve.PointAtParameter(firstItem, code_block)
select_model_element_2 = DSModelElementSelection()  # 1 picked in the model
geometry_2 = Element.Geometry(select_model_element_2)
firstItem_2 = List.FirstItem(geometry_2)
dynanimate_target_position_with = Custom[Dynanimate Target Position With Fixed Camera Position](Iterations=integer_slider, Directory_Path=directory_path, View=views, Camera_Position=pointAtParameter, Target_Path=firstItem_2)  # Animates the target position of a perspective view with a fixed camera position.
