# Dynamo graph Numeric Parameter And Camera Position With Fixed Target.dyn (Dynamo 0.7.5.3566)

iterations = IntegerSlider(10, range=0..300)
directory_path = Directory("C:\temp")
views = Views("Animation View (Unlocked)")
family_types = FamilyTypes("Single Window:Standard")
all_elements_of_family_type = ElementsOfFamilyType(family_types)
parameter_name = CodeBlock { "Height"; }
code_block = CodeBlock { 1200; 2700; }
camera_path_curve = DSModelElementSelection()  # 1 picked in the model
geometry = Element.Geometry(camera_path_curve)
firstItem = List.FirstItem(geometry)
select_model_element = DSModelElementSelection()  # 1 picked in the model
geometry_2 = Element.Geometry(select_model_element)
byUnion = Solid.ByUnion(geometry_2)
centroid = Solid.Centroid(byUnion)
dynanimate_numeric_parameter_and = Custom[Dynanimate Numeric Parameter And Camera Position With Fixed Target](Iterations=iterations, Directory_Path=directory_path, View=views, Elements=all_elements_of_family_type, Parameter_Name=parameter_name, Min_Param_Value=code_block.out0, Max_Param_Value=code_block.out1, Camera_Path=firstItem, Target_Position=centroid)  # Animates the camera of a perspective view around a fixed target.
