# Dynamo graph Numeric Parameter.dyn (Dynamo 0.7.5.3566)

integer_slider = IntegerSlider(10, range=0..100)
directory_path = Directory("C:\temp")
views = Views("From Yard")
family_types = FamilyTypes("Single Window:Standard")
all_elements_of_family_type = ElementsOfFamilyType(family_types)
string = StringInput("Height")
code_block = CodeBlock()
# ---------- code_block.designscript (8 lines) ----------
// Depending on which Dynamo version you are running you may need to significantly alter these parameter values.
// In Dynamo 0.7.x set these values to imperial units (or convert them to imperial units before sending them to the Dynanimate node), e.g. Min = 2 ft, Max = 6.5 ft
// In Dynamo 0.8.x set these values according to the unit settings of your Revit project, e.g. Min = 1200 mm, Max = 2700 mm

// Min. parameter value
2;
// Max. parameter value
6.5;
# ----------------------------------------
dynanimate_numeric_parameter = Custom[Dynanimate Numeric Parameter](Iterations=integer_slider, Directory_Path=directory_path, View=views, Elements=all_elements_of_family_type, Parameter_Name=string, Min_Param_Value=code_block.out0, Max_Param_Value=code_block.out1)  # Animates parameter values of a selection of elements.
