# Dynamo graph Phases.dyn (Dynamo 0.7.5.3566)

directory_path = Directory("C:\temp")
views = Views("From Yard")
dynanimate_phases_as_image = Custom[Dynanimate Phases (As Image)](Directory_Path=directory_path, View=views)  # Animates the phases of a project in a given view.
