# Dynamo graph Solar Study And Camera Position With Fixed Target.dyn (Dynamo 0.7.5.3566)

directory_path = Directory("C:\temp")
views = Views("From Yard (Solar Study)")
select_model_element = DSModelElementSelection()  # 1 picked in the model
geometry = Element.Geometry(select_model_element)
firstItem = List.FirstItem(geometry)
select_model_element_2 = DSModelElementSelection()  # 1 picked in the model
geometry_2 = Element.Geometry(select_model_element_2)
byUnion = Solid.ByUnion(geometry_2)
centroid = Solid.Centroid(byUnion)
dynanimate_solar_study_and = Custom[Dynanimate Solar Study And Camera Position With Fixed Target (As Image)](Directory_Path=directory_path, View=views, Camera_Path=firstItem, Target_Position=centroid)  # Animates the frames of a solar study in a given view.
