# Dynamo graph Solar Study.dyn (Dynamo 0.7.5.3566)

directory_path = Directory("C:\temp")
views = Views("From Yard (Solar Study)")
dynanimate_solar_study_as_image = Custom[Dynanimate Solar Study (As Image)](Directory_Path=directory_path, View=views)  # Animates the phases of a project in a given view.
