# Dynamo graph Numeric Parameter And Camera Position With Fixed Target.dyn (Dynamo 0.7.5.3566)

iterations = IntegerSlider(80, range=0..300)
directory_path = Directory("C:\img")
views = Views("Dynanimator_Perspective_View")
family_types = FamilyTypes("Double Vertical:-")
all_elements_of_family_type = ElementsOfFamilyType(family_types)
parameter_name = CodeBlock { "Width"; }
code_block = CodeBlock { 4; 14; }
camera_path_curve = DSModelElementSelection()  # 1 picked in the model
geometry = Element.Geometry(camera_path_curve)
firstItem = List.FirstItem(geometry)
target_face = DSPointOnElementSelection()  # 1 picked in the model
firstItem_2 = List.FirstItem(target_face)
dynanimate_numeric_parameter_and = Custom[Dynanimate Numeric Parameter And Camera Position With Fixed Target](Iterations=iterations, Directory_Path=directory_path, View=views, Elements=all_elements_of_family_type, Parameter_Name=parameter_name, Min_Param_Value=code_block.out0, Max_Param_Value=code_block.out1, Camera_Path=firstItem, Target_Position=firstItem_2)  # Animates the camera of a perspective view around a fixed target.
watch = Watch(firstItem)
