# Dynamo graph Numeric Parameter.dyn (Dynamo 0.7.5.3566)

code_block = CodeBlock { 4; 14; }
toFeet = Custom[Meters.ToFeet](m=code_block.out0)  # Converts meters into feet
toFeet_2 = Custom[Meters.ToFeet](m=code_block.out1)
integer_slider = IntegerSlider(80, range=0..300)
directory_path = Directory("C:\img")
views = Views("South")
family_types = FamilyTypes("Double Vertical:-")
all_elements_of_family_type = ElementsOfFamilyType(family_types)
code_block_2 = CodeBlock { "Width"; }
dynanimate_numeric_parameter = Custom[Dynanimate Numeric Parameter](Iterations=integer_slider, Directory_Path=directory_path, View=views, Elements=all_elements_of_family_type, Parameter_Name=code_block_2, Min_Param_Value=code_block.out0, Max_Param_Value=code_block.out1)  # Animates parameter values of a selection of elements.
