# Dynamo graph Camera And Target Position.dyn (Dynamo 0.7.5.3566)

integer_slider = IntegerSlider(10, range=0..100)
directory_path = Directory("C:\Users\adieckmann\Desktop")
views = Views("Dynanimator_Perspective_View")
select_model_element = DSModelElementSelection()  # 1 picked in the model
geometry = Element.Geometry(select_model_element)
firstItem = List.FirstItem(geometry)
select_model_element_2 = DSModelElementSelection()  # 1 picked in the model
geometry_2 = Element.Geometry(select_model_element_2)
firstItem_2 = List.FirstItem(geometry_2)
dynanimate_camera_and_target = Custom[Dynanimate Camera And Target Position](Total_Iterations=integer_slider, Directory_Path=directory_path, View=views, Camera_Path=firstItem, Target_Path=firstItem_2)  # Animates the camera and target position of a perspective view.
