# Dynamo graph Element Color.dyn (Dynamo 0.7.5.3566)

integer_slider = IntegerSlider(10, range=0..100)
directory_path = Directory("C:\Users\adieckmann\Desktop")
select_model_elements = DSModelElementsSelection()  # 1 picked in the model
red = Custom[Color.Red]()  # Returns the colour red.
blue = Custom[Color.Blue]()  # Returns the colour blue.
dynanimate_element_color = Custom[Dynanimate Element Color](Total_Iterations=integer_slider, Directory_Path=directory_path, Elements=select_model_elements, Start_Color=red, End_Color=blue)  # Animates the color of a selection of elements in the active view.
