# Dynamo graph Numeric Parameter And Camera Position With Fixed Target.dyn (Dynamo 0.7.5.3566)

integer_slider = IntegerSlider(30, range=0..100)
directory_path = Directory("C:\Users\adieckmann\Desktop")
views = Views("Dynanimator_Perspective_View")
select_model_element = DSModelElementSelection()  # 1 picked in the model
code_block = CodeBlock { "Breite"; }
code_block_2 = CodeBlock { 1; 25; }
select_model_element_2 = DSModelElementSelection()  # 1 picked in the model
geometry = Element.Geometry(select_model_element_2)
firstItem = List.FirstItem(geometry)
select_point_on_face = DSPointOnElementSelection()  # 1 picked in the model
firstItem_2 = List.FirstItem(select_point_on_face)
dynanimate_numeric_parameter_and = Custom[Dynanimate Numeric Parameter And Camera Position With Fixed Target](Iterations=integer_slider, Directory_Path=directory_path, View=views, Elements=select_model_element, Parameter_Name=code_block, Min_Param_Value=code_block_2.out0, Max_Param_Value=code_block_2.out1, Camera_Path=firstItem, Target_Position=firstItem_2)  # Animates the camera of a perspective view around a fixed target.
