# Dynamo graph Numeric Parameter.dyn (Dynamo 0.7.5.3566)

integer_slider = IntegerSlider(5, range=0..100)
directory_path = Directory("C:\Users\adieckmann\Desktop")
views = Views("{3D}")
select_model_elements = DSModelElementsSelection()  # 1 picked in the model
code_block = CodeBlock { "Width"; }
code_block_2 = CodeBlock { 1.2; 3.6; }
toFeet = Custom[Meters.ToFeet](m=code_block_2.out0)  # Converts meters into feet
toFeet_2 = Custom[Meters.ToFeet](m=code_block_2.out1)
dynanimate_numeric_parameter = Custom[Dynanimate Numeric Parameter](Iterations=integer_slider, Directory_Path=directory_path, View=views, Elements=select_model_elements, Parameter_Name=code_block, Min_Param_Value=toFeet, Max_Param_Value=toFeet_2)  # Animates the parameter values of a selection of elements in a given view.
