# Dynamo graph Target Position With Fixed Camera.dyn (Dynamo 0.7.5.3566)

integer_slider = IntegerSlider(10, range=0..100)
directory_path = Directory("C:\Users\adieckmann\Desktop")
views = Views("Dynanimator_Perspective_View")
select_model_element = DSModelElementSelection()  # 1 picked in the model
location = FamilyInstance.Location(select_model_element)
select_model_element_2 = DSModelElementSelection()  # 1 picked in the model
geometry = Element.Geometry(select_model_element_2)
firstItem = List.FirstItem(geometry)
dynanimate_target_position_with = Custom[Dynanimate Target Position With Fixed Camera Position](Iterations=integer_slider, Directory_Path=directory_path, View=views, Camera_Position=location, Target_Path=firstItem)  # Animates the target position of a perspective view with a fixed camera position.
