# Dynamo graph rac_basic_sample_project.dyn (Dynamo 0.8.0.950)

integer_slider = IntegerSlider(25, range=1..50 step 1)
code_block = CodeBlock(n=integer_slider) { 1..n..#n; }
directory_path = Directory("C:\img")
views = Views("From Yard")
family_types = FamilyTypes("Single Window:Standard")
all_elements_of_family_type = ElementsOfFamilyType(family_types)
string = StringInput("Height")
code_block_2 = CodeBlock { 1200; 2700; }
dynanimatorfunction_numeric = Custom[DynanimatorFunction Numeric Parameter](Total_Iterations=integer_slider, Directory_Path=directory_path, View=views, Elements=all_elements_of_family_type, Parameter_Name=string, Min_Param_Value=code_block_2.out0, Max_Param_Value=code_block_2.out1)  # Helper function for Dynanimate Numeric Parameter
map = List.Map(list=code_block, f_x=dynanimatorfunction_numeric)
